# Grasshopper definition SampleExporter.gh (Grasshopper 1.0.7)

panel = Panel("""0
2""")
panel_2 = Panel("""1
2
4""")
panel_3 = Panel("""1
4
6""")
sampletype = Slider(2, range=0..15)
id = Slider(1, range=0..50)
panel_4 = Panel("""Empty
Facade
Appartment
Storage
Bathroom
Kitchen
Circulation""")
panel_5 = Panel("""2
3""")
panel_6 = Panel("""2
6""")
panel_7 = Panel("""2
3
4
5""")
c_script = CSharpScript(
    Export=Button(),
    Path="D:\Unity\ALIS_WFC\RhinoExport\",
    BlockNames="block",
    InstanceLayer="Instances",
    Id=id,
    Type=sampletype,
    minX=panel,
    plusX=panel_5,
    minY=panel_2,
    plusY=panel_6,
    minZ=panel_3,
    plusZ=panel_7)  # -> out; inputs Export: Boolean, Path: String, BlockNames: list of String, InstanceLayer: String, Id: Int32, Type: Int32, minX: list of Int32, plusX: list of Int32, minY: list of Int32, plusY: list of Int32, minZ: list of Int32, plusZ: list of Int32
# ---------- c_script: C# usings ----------
  using System.Linq;
  using System.Xml;
  using System.Xml.Serialization;
  using Rhino.DocObjects;
# ---------- c_script: C# ----------
    List<List<int>> possibleNeighbours = new List<List<int>>{minX,plusX,minY,plusY,minZ,plusZ};
    Sample.Export(BlockNames, InstanceLayer, Path, Id, Type, possibleNeighbours, Rhino.RhinoDoc.ActiveDoc);

    //assembly.Export(BlockNames,IntanceLayer,1,1,1,Filename,
# ---------- c_script: C# additional code ----------
  //Reduced version of the Extensions Unity Exporter script by Vicente
  public class Sample
  {
    public List<Instance> Instances { get; set; }

    public int _idSample;
    public int _type;
    public List<List<int>> _possibleNeighbours;

    private Sample() { }

    public static void Export(List<string> blockNames, string instanceLayerName, string path, int id, int type, List<List<int>> possibleNeighbours, RhinoDoc doc)
    {
      var definitions = blockNames.Select(n => doc.InstanceDefinitions.First(i => i.Name == n));

      var instanceLayer = doc.Layers.FindName(instanceLayerName);

      var sample = new Sample()
        {

          Instances = definitions
          .SelectMany(d => d.GetReferences(1).Where(i => i.Attributes.LayerIndex == instanceLayer.Index))
          .Select(d => new Instance(d.InstanceDefinition.Index, d.InstanceXform))
          .ToList(),

          };
      sample._idSample = id;
      sample._type = type;
      sample._possibleNeighbours = possibleNeighbours;
      var serializer = new XmlSerializer(typeof(Sample));
      using (var writer = XmlWriter.Create(path + "sample_" + id + ".xml"))
      {
        serializer.Serialize(writer, sample);
      }
    }
  }


  public class Instance
  {
    public int DefinitionIndex;
    public Pose Pose;


    private Instance() { }

    public Instance(int definitionIndex, Transform transform)
    {
      DefinitionIndex = definitionIndex;

      var plane = Plane.WorldXY;
      plane.Transform(transform);
      Pose = new Pose(plane);
    }
  }

  [XmlType(TypeName = "Vector3")]
  public struct Vector3Export
  {
    public float x, y, z;

    public Vector3Export(Point3d point)
    {
      x = (float) point.X;
      y = (float) point.Z;
      z = (float) point.Y;
    }

    public Vector3Export(Point3f point)
    {
      x = point.X;
      y = point.Z;
      z = point.Y;
    }
  }

  [XmlType(TypeName = "Vector2")]
  public struct Vector2Export
  {
    public float x, y;

    public Vector2Export(Point2f point)
    {
      x = point.X;
      y = point.Y;
    }
  }

  public struct Pose
  {
    public Vector3Export position;
    public QuaternionExport rotation;

    public Pose(Plane plane)
    {
      position = new Vector3Export(plane.Origin);
      rotation = new QuaternionExport(plane);
    }
  }

  [XmlType(TypeName = "Quaternion")]
  public struct QuaternionExport
  {
    public float x, y, z, w;

    public QuaternionExport(Plane plane)
    {
      var q = Quaternion.Rotation(Plane.WorldXY, plane);

      w = (float) -q.A;
      x = (float) q.B;
      y = (float) q.D;
      z = (float) q.C;
    }
  }
# ---------- end c_script ----------
item = ListItem(List=panel_4, Index=sampletype, Wrap=True)
panel_8 = Panel(c_script)
panel_9 = Panel(item)
